# Grasshopper definition SURGE_wards.ghx (Grasshopper 1.0.8)

W = Slider(6, range=0..10)
D = Slider(18, range=0..20)
path = FilePath("C:\Users\shahr\OneDrive\Documents\Obsidian\Big Data\Main\rework\data\s4\gh\briefs_gh.csv")
file = ReadFile(File=path, PerLineParse=True)
pt = ConstructPoint(XCoordinate=0, YCoordinate=0, ZCoordinate=0)
pt_2 = ConstructPoint(XCoordinate=W, YCoordinate=D, ZCoordinate=0)
item = ListItem(List=file, Index=0, Wrap=True)  # -> Item, Item1, Item2, Item3, Item4
list = ValueList({"One": 0, "Two": 1, "Three": 2, "Four": 3}, selected="One")
item_2 = ListItem(List=[item.Item1, item.Item2, item.Item3, item.Item4], Index=list, Wrap=True)
rec_2pt = Rectangle2Pt(Plane=PlaneXY(0, 0, 0), PointA=pt, PointB=pt_2, Radius=0)  # -> Rectangle, Length
split = TextSplit(Text=item.Item, Separators=",")
split_2 = TextSplit(Text=item_2, Separators=",")
series = Series(Start=0, Step=1, Count=Slider(5, range=0..10))
panel = Panel(split)
panel_2 = Panel(split_2)
multiplication = Multiplication(A=W, B=series)
addition = Addition(A=W, B=multiplication)
item_3 = ListItem(List=split_2, Index="4", Wrap=True)
item_4 = ListItem(List=split_2, Index="3", Wrap=True)
item_5 = ListItem(List=split_2, Index="2", Wrap=True)
pt_3 = ConstructPoint(XCoordinate=multiplication, YCoordinate=0, ZCoordinate=0)
pt_4 = ConstructPoint(XCoordinate=addition, YCoordinate=D, ZCoordinate=0)
rec_2pt_2 = Rectangle2Pt(Plane=PlaneXY(0, 0, 0), PointA=pt_3, PointB=pt_4, Radius=0)  # -> Rectangle, Length
bay = Slider(6, range=0..10)
fence_gap = Slider(1, range=0..10)
green_col_bays = Slider(2, range=0..10)
max_per_row = Slider(5, range=0..10)
multiplication_2 = Multiplication(A=green_col_bays, B=bay)
max = Maximum(A=item_4, B=item_3)
addition_2 = Addition(A=multiplication_2, B=fence_gap)
max_2 = Maximum(A=item_5, B=max)
min = Minimum(A=max_per_row, B=max_2)
addition_3 = Addition(A=addition_2, B=bay)
division = Division(A=item_5, B=min)
division_2 = Division(A=item_4, B=min)
division_3 = Division(A=item_3, B=min)
round = Round(Suspected=division)  # -> Nearest, Floor, Ceiling
round_2 = Round(Confirmed=division_3)  # -> Nearest, Floor, Ceiling
round_3 = Round(Probable=division_2)  # -> Nearest, Floor, Ceiling
addition_4 = Addition(A=round.Ceiling, B=round_3.Ceiling)
merge = Merge(Data1="0", Data2=round.Ceiling, Data3=addition_4)  # -> simplify(flatten(Start_row))
ma = MassAddition(Input=[round.Ceiling, round_3.Ceiling, round_2.Ceiling])  # -> TotalRows, PartialResults

# ---- group: Staff Entry/Exist / x_red
data = Data(addition_2)

# ---- group: Staff Entry/Exist / BAY
data_2 = Data(bay)

# ---- group: Patients Entery/Circulation / Area Family Visiting
item_6 = ListItem(List=split_2, Index="7", Wrap=True)

# ---- group: Patients Entery/Circulation / Area Triage
item_7 = ListItem(List=split_2, Index="6", Wrap=True)

# ---- group: Safe Areas
panel_3 = Panel("""11
12
13
14
15""")
multiplication_3 = Multiplication(A=bay, B=green_col_bays)
item_8 = ListItem(List=split_2, Index=panel_3, Wrap=True)
expression = Expression(a=item_8, d=multiplication_3, BAY=bay, Expression="Max(1, Ceiling(a / d / BAY)) * BAY")
ma_2 = MassAddition(Input=expression)  # -> Result, PartialResults
subtraction = Subtraction(A=ma_2.PartialResults, B=expression)
pt_5 = ConstructPoint(XCoordinate=0, YCoordinate=subtraction, ZCoordinate=0)
pt_6 = ConstructPoint(XCoordinate=multiplication_3, YCoordinate=ma_2.PartialResults, ZCoordinate=0)
rec_2pt_3 = Rectangle2Pt(Plane=PlaneXY(0, 0, 0), PointA=pt_5, PointB=pt_6, Radius=0)  # -> Rectangle, Length

# ----
panel_4 = Panel("""8
9
10""")
item_9 = ListItem(List=split, Index=panel_4, Wrap=True)
item_10 = ListItem(List=split_2, Index=panel_4, Wrap=True)
expression_2 = Expression(a=item_10, d=bay, BAY=bay, Expression="Max(1, Ceiling(a / d / BAY)) * BAY")
panel_5 = Panel("""16
17
18""")
item_11 = ListItem(List=split_2, Index=panel_5, Wrap=True)
item_12 = ListItem(List=expression_2, Index=0, Wrap=True)  # -> Item, Item1, Item2
item_13 = ListItem(List=item_11, Index=0, Wrap=True)  # -> Item, Item1, Item2
multiplication_4 = Multiplication(A=bay, B=2)
om = Slider(6, range=0..10)
expression_3 = Expression(a=item_13.Item, d=bay, BAY=bay, Expression="Max(1, Ceiling(a / d / BAY)) * BAY")
expression_4 = Expression(a=item_13.Item2, d=multiplication_4, BAY=bay, Expression="Max(1, Ceiling(a / d / BAY)) * BAY")
expression_5 = Expression(a=item_13.Item1, d=bay, BAY=bay, Expression="Max(1, Ceiling(a / d / BAY)) * BAY")
expression_6 = Expression(OM=om, BAY=bay, Expression="-OM - BAY")
addition_5 = Addition(A=data, B=bay)
addition_6 = Addition(A=expression_3, B=bay)
addition_7 = Addition(A=addition_6, B=expression_5, C=bay)
addition_8 = Addition(A=addition_5, B=item_12.Item)
subtraction_2 = Subtraction(A=expression_6, B=bay)
addition_9 = Addition(A=addition_7, B=expression_4)
addition_10 = Addition(A=expression_6, B=bay)
addition_11 = Addition(A=addition_6, B=expression_5)
addition_12 = Addition(A=expression_6, B=bay)
addition_13 = Addition(A=expression_6, B=bay)
pt_7 = ConstructPoint(XCoordinate=expression_3, YCoordinate=addition_13, ZCoordinate=0)
pt_8 = ConstructPoint(XCoordinate=addition_11, YCoordinate=addition_12, ZCoordinate=0)
pt_9 = ConstructPoint(XCoordinate=0, YCoordinate=expression_6, ZCoordinate=0)
pt_10 = ConstructPoint(XCoordinate=addition_6, YCoordinate=expression_6, ZCoordinate=0)
pt_11 = ConstructPoint(XCoordinate=addition_9, YCoordinate=addition_10, ZCoordinate=0)
pt_12 = ConstructPoint(XCoordinate=addition_7, YCoordinate=subtraction_2, ZCoordinate=0)

# ---- group: Water
rec_2pt_4 = Rectangle2Pt(Plane=PlaneXY(0, 0, 0), PointA=pt_9, PointB=pt_7, Radius=0)  # -> Rectangle, Length

# ---- group: generator
rec_2pt_5 = Rectangle2Pt(Plane=PlaneXY(0, 0, 0), PointA=pt_10, PointB=pt_8, Radius=0)  # -> Rectangle, Length

# ---- group: loading
rec_2pt_6 = Rectangle2Pt(Plane=PlaneXY(0, 0, 0), PointA=pt_12, PointB=pt_11, Radius=0)  # -> Rectangle, Length

# ----
expression_7 = Expression(x_red=data, FG=fence_gap, Expression="x_red - FG / 2")
ridge = Slider(4.6, range=0..10)
eave = Slider(2.8, range=0..10)
division_4 = Division(A=W, B=2)
division_5 = Division(A=D, B=2)
addition_14 = Addition(A=data, B=bay)
division_6 = Division(A=bay, B=2)
pt_13 = ConstructPoint(XCoordinate=addition_14, YCoordinate=division_6, ZCoordinate=0)
H = Slider(3, range=0..10)
Y = UnitY(Factor=D)
merge_2 = Merge(Data1=rec_2pt_4.Rectangle, Data2=rec_2pt_5.Rectangle, Data3=rec_2pt_6.Rectangle)
Z = UnitZ(Factor=H)
Z_2 = UnitZ(Factor=H)
Z_3 = UnitZ(Factor=H)
Z_4 = UnitZ(Factor=H)
boundary = BoundarySurfaces(Edges=merge_2)
extr = Extrude(Base=boundary, Direction=Z_4)
preview = CustomPreview(Geometry=extr, Material=ColourSwatch(SwatchColor=RGB(138, 136, 127)))

# ---- group: Group 3
gap = Slider(3, range=0..10)
series_2 = Series(Start=0, Step=1, Count=graft([item_5, item_4, item_3]))
mod = Modulus(A=series_2, B=min)
integer_division = IntegerDivision(A=series_2, B=min)
multiplication_5 = Multiplication(A=mod, B=W)

# ----
addition_15 = Addition(A=bay, B=gap)
addition_16 = Addition(A=D, B=gap)

# ---- group: Staff Entry/Exist
series_3 = Series(Start=0, Step=1, Count=ma.TotalRows)
multiplication_6 = Multiplication(A=addition_16, B=series_3)
addition_17 = Addition(A=multiplication_6, B=addition_15)
addition_18 = Addition(A=data, B=data_2)
addition_19 = Addition(A=data_2, B=addition_17)
addition_20 = Addition(A=data_2, B=addition_19)
addition_21 = Addition(A=data_2, B=addition_20)
pt_14 = ConstructPoint(XCoordinate=data, YCoordinate=addition_19, ZCoordinate=0)
pt_15 = ConstructPoint(XCoordinate=addition_18, YCoordinate=addition_20, ZCoordinate=0)
pt_16 = ConstructPoint(XCoordinate=addition_18, YCoordinate=addition_19, ZCoordinate=0)
pt_17 = ConstructPoint(XCoordinate=data, YCoordinate=addition_20, ZCoordinate=0)
pt_18 = ConstructPoint(XCoordinate=addition_18, YCoordinate=addition_21, ZCoordinate=0)
pt_19 = ConstructPoint(XCoordinate=data, YCoordinate=addition_17, ZCoordinate=0)
rec_2pt_7 = Rectangle2Pt(Plane=PlaneXY(0, 0, 0), PointA=pt_19, PointB=pt_16, Radius=0)  # -> Rectangle, Length
rec_2pt_8 = Rectangle2Pt(Plane=PlaneXY(0, 0, 0), PointA=pt_14, PointB=pt_15, Radius=0)  # -> Rectangle, Length
rec_2pt_9 = Rectangle2Pt(Plane=PlaneXY(0, 0, 0), PointA=pt_17, PointB=pt_18, Radius=0)  # -> Rectangle, Length

# ----
addition_22 = Addition(A=addition_3, B=multiplication_5)

# ---- group: Group 3 (continued)
expression_8 = Expression(
    row=simplify(integer_division),
    start_row=graft(merge),
    Y0=addition_15,
    pitch=addition_16,
    Expression="Y0 + (start_row + row) * pitch")
addition_23 = Addition(A=addition_22, B=W)
addition_24 = Addition(A=expression_8, B=D)
pt_20 = ConstructPoint(XCoordinate=addition_22, YCoordinate=expression_8, ZCoordinate=0)
pt_21 = ConstructPoint(XCoordinate=addition_23, YCoordinate=addition_24, ZCoordinate=0)
rec_2pt_10 = Rectangle2Pt(Plane=PlaneXY(0, 0, 0), PointA=pt_20, PointB=pt_21, Radius=0)  # -> simplify(Rectangle), Length

# ---- group: Patients Entery/Circulation
expression_9 = Expression(a=item_6, d=data_2, BAY=bay, Expression="Max(1, Ceiling(a / d / BAY)) * BAY")
expression_10 = Expression(a=item_7, d=data_2, BAY=bay, Expression="Max(1, Ceiling(a / d / BAY)) * BAY")
expression_11 = Expression(Y0=addition_15, total_rows=ma.TotalRows, pitch=addition_16, Expression="Y0 + total_rows * pitch")
expression_12 = Expression(x_mod=addition_3, per_row=min, W=W, Expression="x_mod + per_row * W")
pc = Slider(3, range=0..10)
multiplication_7 = Multiplication(A=bay, B=2)
max_3 = Maximum(A=expression_10, B=multiplication_7)
addition_25 = Addition(A=expression_12, B=pc)
subtraction_3 = Subtraction(A=expression_11, B=gap)
addition_26 = Addition(A=data, B=max_3)
addition_27 = Addition(A=addition_26, B=expression_9)
pt_22 = ConstructPoint(XCoordinate=data, YCoordinate=0, ZCoordinate=0)
pt_23 = ConstructPoint(XCoordinate=addition_26, YCoordinate=bay, ZCoordinate=0)
pt_24 = ConstructPoint(XCoordinate=addition_26, YCoordinate=0, ZCoordinate=0)
pt_25 = ConstructPoint(XCoordinate=addition_27, YCoordinate=bay, ZCoordinate=0)
pt_26 = ConstructPoint(XCoordinate=expression_12, YCoordinate=bay, ZCoordinate=0)
pt_27 = ConstructPoint(XCoordinate=addition_25, YCoordinate=subtraction_3, ZCoordinate=0)
rec_2pt_11 = Rectangle2Pt(Plane=PlaneXY(0, 0, 0), PointA=pt_22, PointB=pt_23, Radius=0)  # -> Rectangle, Length
rec_2pt_12 = Rectangle2Pt(Plane=PlaneXY(0, 0, 0), PointA=pt_24, PointB=pt_25, Radius=0)  # -> Rectangle, Length
rec_2pt_13 = Rectangle2Pt(Plane=PlaneXY(0, 0, 0), PointA=pt_26, PointB=pt_27, Radius=0)  # -> Rectangle, Length

# ----
expression_13 = Expression(
    x_corr=expression_12,
    PC=pc,
    w_m=item_12.Item1,
    x_red=data,
    BAY=bay,
    w_l=item_12.Item,
    FG=fence_gap,
    Expression="Max(x_corr + PC - w_m, x_red + BAY + w_l + FG)")
expression_14 = Expression(
    x_corr=expression_12,
    PC=pc,
    x_m=expression_13,
    w_m=item_12.Item1,
    FG=fence_gap,
    Expression="Max(x_corr + PC, x_m + w_m) + FG")
addition_28 = Addition(A=bay, B=expression_11)
addition_29 = Addition(A=expression_13, B=item_12.Item1)
addition_30 = Addition(A=expression_14, B=item_12.Item2)
pt_28 = ConstructPoint(XCoordinate=addition_30, YCoordinate=addition_28, ZCoordinate=0)
pt_29 = ConstructPoint(XCoordinate=addition_29, YCoordinate=addition_28, ZCoordinate=0)
pt_30 = ConstructPoint(XCoordinate=expression_14, YCoordinate=expression_11, ZCoordinate=0)
pt_31 = ConstructPoint(XCoordinate=data, YCoordinate=expression_11, ZCoordinate=0)
pt_32 = ConstructPoint(XCoordinate=addition_8, YCoordinate=addition_28, ZCoordinate=0)
pt_33 = ConstructPoint(XCoordinate=expression_13, YCoordinate=expression_11, ZCoordinate=0)
pt_34 = ConstructPoint(XCoordinate=addition_5, YCoordinate=addition_28, ZCoordinate=0)
pt_35 = ConstructPoint(XCoordinate=addition_5, YCoordinate=expression_11, ZCoordinate=0)

# ---- group: incinerator
rec_2pt_14 = Rectangle2Pt(Plane=PlaneXY(0, 0, 0), PointA=pt_30, PointB=pt_28, Radius=0)  # -> Rectangle, Length

# ---- group: discharge
rec_2pt_15 = Rectangle2Pt(Plane=PlaneXY(0, 0, 0), PointA=pt_31, PointB=pt_34, Radius=0)  # -> Rectangle, Length

# ---- group: Morgue
rec_2pt_16 = Rectangle2Pt(Plane=PlaneXY(0, 0, 0), PointA=pt_33, PointB=pt_29, Radius=0)  # -> Rectangle, Length

# ---- group: Laundry
rec_2pt_17 = Rectangle2Pt(Plane=PlaneXY(0, 0, 0), PointA=pt_35, PointB=pt_32, Radius=0)  # -> Rectangle, Length

# ----
merge_3 = Merge(
    Data1=rec_2pt_15.Rectangle,
    Data2=rec_2pt_17.Rectangle,
    Data3=rec_2pt_16.Rectangle,
    Data4=rec_2pt_14.Rectangle,
    Data5=rec_2pt_10.Rectangle,
    Data6=rec_2pt_3.Rectangle,
    Data7=rec_2pt_11.Rectangle,
    Data8=rec_2pt_12.Rectangle,
    Data9=rec_2pt_13.Rectangle,
    Data10=rec_2pt_7.Rectangle,
    Data11=rec_2pt_8.Rectangle,
    Data12=rec_2pt_9.Rectangle)  # -> flatten(Result)
expression_15 = Expression(BAY=bay, GAP=gap, Expression="BAY + GAP / 2")
bbox = BoundingBox(Content=merge_3, Plane=PlaneXY(0, 0, 0), UnionBox=True)  # -> Box, Box_2
box_corners = BoxCorners(Box=bbox.Box)  # -> CornerA, CornerB, CornerC, CornerD, CornerE, CornerF, CornerG, CornerH
pt_36 = ConstructPoint(XCoordinate=expression_7, YCoordinate=expression_15, ZCoordinate=0)
pdecon = Deconstruct(Point=box_corners.CornerG)  # -> XComponent, YComponent, ZComponent
expression_16 = Expression(bx1=pdecon.XComponent, FG=fence_gap, Expression="bx1 + FG / 2")
pt_37 = ConstructPoint(XCoordinate=expression_16, YCoordinate=addition_28, ZCoordinate=0)
rec_2pt_18 = Rectangle2Pt(Plane=PlaneXY(0, 0, 0), PointA=box_corners.CornerA, PointB=box_corners.CornerG, Radius=0)  # -> Rectangle, Length
offset = OffsetCurve(Curve=rec_2pt_18.Rectangle, Distance=om, Corners=1)
rec_2pt_19 = Rectangle2Pt(Plane=PlaneXY(0, 0, 0), PointA=pt_36, PointB=pt_37, Radius=0)  # -> Rectangle, Length
merge_4 = Merge(Data1=pt_20)
pdecon_2 = Deconstruct(Point=merge_4)  # -> XComponent, YComponent, ZComponent
cset = CreateSet(List=flatten(expression_8))  # -> Set, Map
division_7 = Division(A=pc, B=2)
addition_31 = Addition(A=division_4, B=pdecon_2.XComponent)
addition_32 = Addition(A=W, B=pdecon_2.XComponent)
addition_33 = Addition(A=expression_12, B=division_7)
addition_34 = Addition(A=division_6, B=expression_11)
addition_35 = Addition(A=division_5, B=cset.Set)
pt_38 = ConstructPoint(XCoordinate=addition_33, YCoordinate=addition_35, ZCoordinate=0)
pt_39 = ConstructPoint(XCoordinate=addition_33, YCoordinate=addition_34, ZCoordinate=0)
pt_40 = ConstructPoint(XCoordinate=pdecon_2.XComponent, YCoordinate=pdecon_2.YComponent, ZCoordinate=0)  # -> graft(Point)
pt_41 = ConstructPoint(XCoordinate=pdecon_2.XComponent, YCoordinate=pdecon_2.YComponent, ZCoordinate=eave)  # -> graft(Point)
pt_42 = ConstructPoint(XCoordinate=addition_31, YCoordinate=pdecon_2.YComponent, ZCoordinate=ridge)  # -> graft(Point)
pt_43 = ConstructPoint(XCoordinate=addition_32, YCoordinate=pdecon_2.YComponent, ZCoordinate=eave)  # -> graft(Point)
pt_44 = ConstructPoint(XCoordinate=addition_32, YCoordinate=pdecon_2.YComponent, ZCoordinate=0)  # -> graft(Point)
pt_45 = ConstructPoint(XCoordinate=addition_33, YCoordinate=division_6, ZCoordinate=0)
merge_5 = Merge(Data1=pt_13, Data2=pt_45, Data3=pt_38, Data4=pt_39)  # -> flatten(Result)
merge_6 = Merge(Data1=pt_40, Data2=pt_41, Data3=pt_42, Data4=pt_43, Data5=pt_44)  # -> simplify(Result)
pline = PolyLine(Vertices=merge_5, Closed=False)
pline_2 = PolyLine(Vertices=merge_6, Closed=True)
boundary_2 = BoundarySurfaces(Edges=pline_2)
merge_7 = Merge(Data1=rec_2pt_13.Rectangle, Data2=rec_2pt_16.Rectangle, Data3=rec_2pt_14.Rectangle)
merge_8 = Merge(Data1=rec_2pt_15.Rectangle, Data2=rec_2pt_17.Rectangle, Data3=rec_2pt_11.Rectangle, Data4=rec_2pt_12.Rectangle)
merge_9 = Merge(Data1=rec_2pt_3.Rectangle, Data2=rec_2pt_7.Rectangle, Data3=rec_2pt_8.Rectangle, Data4=rec_2pt_9.Rectangle)
extr_2 = Extrude(Base=boundary_2, Direction=Y)
boundary_3 = BoundarySurfaces(Edges=merge_7)
boundary_4 = BoundarySurfaces(Edges=merge_8)
boundary_5 = BoundarySurfaces(Edges=merge_9)
pshift = ShiftPaths(Data=extr_2, Offset=-1)
extr_3 = Extrude(Base=boundary_3, Direction=Z)
extr_4 = Extrude(Base=boundary_4, Direction=Z_2)
extr_5 = Extrude(Base=boundary_5, Direction=Z_3)
bang = ExplodeTree(Data=pshift)  # -> Branch0, Branch1, Branch2
preview_2 = CustomPreview(Geometry=pline, Material=ColourSwatch(SwatchColor=RGB(42, 120, 214)))
preview_3 = CustomPreview(Geometry=extr_3, Material=ColourSwatch(SwatchColor=RGB(227, 73, 72)))
preview_4 = CustomPreview(Geometry=bang.Branch0, Material=ColourSwatch(SwatchColor=RGB(246, 185, 178)))
preview_5 = CustomPreview(Geometry=bang.Branch1, Material=ColourSwatch(SwatchColor=RGB(238, 139, 129)))
preview_6 = CustomPreview(Geometry=bang.Branch2, Material=ColourSwatch(SwatchColor=RGB(184, 48, 47)))
preview_7 = CustomPreview(Geometry=extr_4, Material=ColourSwatch(SwatchColor=RGB(237, 161, 0)))
preview_8 = CustomPreview(Geometry=extr_5, Material=ColourSwatch(SwatchColor=RGB(27, 175, 122)))
